% Simulink data dictionary ModelDictionary.sldd

angleHip = [0.1886164; 0.188616; 0.188615; 0.1886133; 0.1886109; 0.1886079; 0.1886041; 0.1885997; 0.1885946; 0.1885889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 0.1886382]
angleKnee = [0; 2.6865e-06; 1.073272e-05; 2.411876e-05; 4.28247e-05; 6.683063e-05; 9.611665e-05; 0.0001306628; 0.0001704493; 0.000215456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 6.471225e-05]

EtherCATReceivedFromBMS = Simulink.Bus()
  stateBMS: double
  statusChargeBattery: double
  statusTemperatureBattery: double
  minVoltCell: double
  maxVoltCell: double

EtherCATReceivedFromInputDevice = Simulink.Bus()
  desiredState: double
  error: double

EtherCATReceivedFromPDB = Simulink.Bus()
  statePDB: double
  statusCurrentBattery: double
  statusVoltageBattery: double
  statusTemperatureDCDC: double

EtherCATReceivedFromPowerElectronics = Simulink.Bus()
  receivedFromPDB: Bus: EtherCATReceivedFromPDB
  receivedFromBMS: Bus: EtherCATReceivedFromBMS

EtherCATSendToInputDevice = Simulink.Bus()
  state: double
  message: double

EtherCATSendToPDB = Simulink.Bus()
  masterOP: double

EtherCATSendToPowerElectronics = Simulink.Bus()
  sendToPDB: Bus: EtherCATSendToPDB

ExoskeletonData = Simulink.Bus()
  etherCATData: Bus: EtherCATData
  error: Bus: DeviceErrors
  gaitPhase: double
  masterState: Enum: ExoskeletonState
  miscDataSOMANETs: Bus: MiscDataSOMANET

GaitGeneratorInput = Simulink.Bus()
  targetLeg: Enum: Leg
  stepType: Enum: StepType

JointDynamics = Simulink.Bus()
  angle: double
  velocity: double
  torque: double

MiscDataSOMANET = Simulink.Bus()
  jointControlConfigs: Bus: JointControlConfig[1 4]

PowerElectronicsError = Simulink.Bus()
  errorPDB: double
  errorBMS: double

EtherCATSendToSOMANET = Simulink.Bus()
  controlword: Enum: SomanetControlWord
  opMode: Enum: SomanetOpmode
  targetAngle: double
  targetVelocity: double
  targetTorque: double
  tuningCommand: double
  userMOSI: double
  maxTorque: double

JointControlConfigLHFE = struct(
  angleOffset=1245,
  polePairs=21,
  minPosLimit=-134.9,
  maxPosLimit=-86.2,
  maxSpeed=60,
  maxTorque=2.122,
  positionKp=500000,
  positionKi=0,
  positionKd=0,
  positionIntegralLimit=2122,
  velocityKp=600000,
  velocityKi=10000,
  velocityKd=0,
  velocityIntegralLimit=2122,
  brakeReleaseStrategy=0)

JointControlConfigLHFE_Param = Simulink.Parameter(struct(
  angleOffset=1245,
  polePairs=21,
  minPosLimit=-200,
  maxPosLimit=200,
  maxSpeed=60,
  maxTorque=2.122,
  positionKp=500000,
  positionKi=0,
  positionKd=0,
  positionIntegralLimit=2122,
  velocityKp=600000,
  velocityKi=10000,
  velocityKd=0,
  velocityIntegralLimit=2122,
  brakeReleaseStrategy=0), DataType="Bus: JointControlConfig")

JointControlConfigLKFE = struct(
  angleOffset=1245,
  polePairs=21,
  minPosLimit=-134.9,
  maxPosLimit=-86.2,
  maxSpeed=60,
  maxTorque=2.122,
  positionKp=500000,
  positionKi=0,
  positionKd=0,
  positionIntegralLimit=2122,
  velocityKp=600000,
  velocityKi=10000,
  velocityKd=0,
  velocityIntegralLimit=2122,
  brakeReleaseStrategy=0)

JointControlConfigLKFE_Param = Simulink.Parameter(struct(
  angleOffset=1245,
  polePairs=21,
  minPosLimit=-200,
  maxPosLimit=200,
  maxSpeed=60,
  maxTorque=2.122,
  positionKp=500000,
  positionKi=0,
  positionKd=0,
  positionIntegralLimit=2122,
  velocityKp=600000,
  velocityKi=10000,
  velocityKd=0,
  velocityIntegralLimit=2122,
  brakeReleaseStrategy=0), DataType="Bus: JointControlConfig")

JointControlConfigRHFE = struct(
  angleOffset=1245,
  polePairs=21,
  minPosLimit=-134.9,
  maxPosLimit=-86.2,
  maxSpeed=60,
  maxTorque=2.122,
  positionKp=500000,
  positionKi=0,
  positionKd=0,
  positionIntegralLimit=2122,
  velocityKp=600000,
  velocityKi=10000,
  velocityKd=0,
  velocityIntegralLimit=2122,
  brakeReleaseStrategy=0)

JointControlConfigRHFE_Param = Simulink.Parameter(struct(
  angleOffset=1245,
  polePairs=21,
  minPosLimit=-200,
  maxPosLimit=200,
  maxSpeed=60,
  maxTorque=2.122,
  positionKp=500000,
  positionKi=0,
  positionKd=0,
  positionIntegralLimit=2122,
  velocityKp=600000,
  velocityKi=10000,
  velocityKd=0,
  velocityIntegralLimit=2122,
  brakeReleaseStrategy=0), DataType="Bus: JointControlConfig")

JointControlConfigRKFE = struct(
  angleOffset=1245,
  polePairs=21,
  minPosLimit=-134.9,
  maxPosLimit=-86.2,
  maxSpeed=60,
  maxTorque=2.122,
  positionKp=500000,
  positionKi=0,
  positionKd=0,
  positionIntegralLimit=2122,
  velocityKp=600000,
  velocityKi=10000,
  velocityKd=0,
  velocityIntegralLimit=2122,
  brakeReleaseStrategy=0)

JointControlConfigRKFE_Param = Simulink.Parameter(struct(
  angleOffset=1245,
  polePairs=21,
  minPosLimit=-200,
  maxPosLimit=200,
  maxSpeed=60,
  maxTorque=2.122,
  positionKp=500000,
  positionKi=0,
  positionKd=0,
  positionIntegralLimit=2122,
  velocityKp=600000,
  velocityKi=10000,
  velocityKd=0,
  velocityIntegralLimit=2122,
  brakeReleaseStrategy=0), DataType="Bus: JointControlConfig")

resolutionJointEncoder = Simulink.Parameter(65536, DataType="double")
maxAngle = Simulink.Parameter(6.283185, Unit="Rad")
maxNonResponsive = Simulink.Parameter(0.3, Unit="seconds")
maxPhasePeakCurrent = Simulink.Parameter(70, Unit="A")
maxTorque = Simulink.Parameter(2.122, Unit="Nm")
maxVelocity = Simulink.Parameter([], Unit="Rad/s")
currentNominal = Simulink.Parameter(10, Unit="A")
currentTimeMaximum = Simulink.Parameter(40, Unit="A")
currentMaximum = Simulink.Parameter(35, Unit="A")
maxAngleDiff = Simulink.Parameter(0.2, Unit="Rad")
maxVelocityDiff = Simulink.Parameter(0.5, Unit="Rad/s")
minAngle = Simulink.Parameter(-1.2566, Unit="Rad")
sampleTime = 0.002

JointControlConfig = Simulink.Bus()
  angleOffset: double
  polePairs: double
  minPosLimit: double
  maxPosLimit: double
  maxSpeed: double
  maxTorque: double
  positionKp: double
  positionKi: double
  positionKd: double
  positionIntegralLimit: double
  velocityKp: double
  velocityKi: double
  velocityKd: double
  velocityIntegralLimit: double
  brakeReleaseStrategy: double

zeroOffsetLHFE = Simulink.Parameter(0, Unit="Rad")
zeroOffsetRHFE = Simulink.Parameter(0, Unit="Rad")
zeroOffsetLKFE = Simulink.Parameter(0, Unit="Rad")
zeroOffsetRKFE = Simulink.Parameter(0, Unit="Rad")
maxPositionDifference = Simulink.Parameter(0.1745, Unit="Rad")

EtherCATReceivedFromGESBack = Simulink.Bus()
  tempRHFE: double
  tempRLFE: double

maxTemperatureJoint = Simulink.Parameter(100, Unit="Celcius")

DeviceErrors = Simulink.Bus()
  errorSOMANETs: Enum: SomanetError[1 4]
  errorInputDevice: Enum: EthercatDeviceError
  errorPowerElectronics: Bus: PowerElectronicsError

EtherCATData = Simulink.Bus()
  receivedFromSOMANETs: Bus: EtherCATReceivedFromSOMANET[1 4]
  receivedFromInputDevice: Bus: EtherCATReceivedFromInputDevice
  receivedFromGESs: Bus: EtherCATReceivedFromGES
  receivedFromPowerElectronics: Bus: EtherCATReceivedFromPowerElectronics
  sendToSOMANETs: Bus: EtherCATSendToSOMANET[1 4]
  sendToInputDevice: Bus: EtherCATSendToInputDevice
  sendToPowerElectronics: Bus: EtherCATSendToPowerElectronics

EtherCATReceivedFromGESJoint = Simulink.Bus()
  temperature: double

EtherCATReceivedFromGES = Simulink.Bus()
  etherCATReceivedFromGESLKFE: Bus: EtherCATReceivedFromGESJoint
  etherCATReceivedFromGESRKFE: Bus: EtherCATReceivedFromGESJoint
  etherCATReceivedFromGESBack: Bus: EtherCATReceivedFromGESBack

maxTemperature = Simulink.Parameter(120, Unit="Degrees")

standUpKnee = [0 95
 0.01332178 95
 0.02664355 95
 0.03996533 95
 0.0532871 95
 0.06660888 95
 0.07993066 95
 0.09325243 95
 0.1065742 95
 0.119896 95
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 ]

standUpHip = [0 92
 0.01332178 92.00001
 0.02664355 92.00003
 0.03996533 92.00008
 0.0532871 92.00014
 0.06660888 92.00021
 0.07993066 92.00031
 0.09325243 92.00042
 0.1065742 92.00054
 0.119896 92.00069
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 ]

sitDownHip = [0 0
 0.03997599 -2.956472e-05
 0.07995198 -0.0001166617
 0.119928 -0.0002588954
 0.159904 -0.00045387
 0.19988 -0.0006991899
 0.2398559 -0.0009924594
 0.2798319 -0.001331283
 0.3198079 -0.001713264
 0.3597839 -0.002136008
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 ]

sitDownKnee = [0 0
 0.03997599 -2.956472e-05
 0.07995198 -0.0001166617
 0.119928 -0.0002588954
 0.159904 -0.00045387
 0.19988 -0.0006991899
 0.2398559 -0.0009924594
 0.2798319 -0.001331283
 0.3198079 -0.001713264
 0.3597839 -0.002136008
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 ]

walkRWHip = [0 2
 0.0333111 2.000053
 0.06662221 2.000211
 0.09993331 2.000475
 0.1332444 2.000844
 0.1665555 2.001317
 0.1998666 2.001896
 0.2331777 2.00258
 0.2664888 2.003367
 0.2997999 2.00426
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 ]

walkRWKnee = [0 7
 0.0333111 7.000348
 0.06662221 7.001391
 0.09993331 7.003126
 0.1332444 7.005551
 0.1665555 7.008662
 0.1998666 7.012458
 0.2331777 7.016935
 0.2664888 7.022092
 0.2997999 7.027924
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 ]

JointCommandDynamic = Simulink.Bus()
  jointDynamics: Bus: JointDynamics
  jointCommand: Enum: JointCommand

EtherCATReceivedFromSOMANET = Simulink.Bus()
  motorPosition: double
  motorVelocity: double
  statusword: double
  actualAngle: double
  actualVelocity: double
  actualTorque: double
  userMISO: double
  tuningStatus: double
  errorSOMANET: double
  statusPhaseCurrentB: double
  statusPhaseCurrentC: double
  opMode: double
  statusTemperature: double
  timestamp: double

maxTemperatureSomanet = Simulink.Parameter(60)